# Grasshopper definition pp.gh (Grasshopper 1.0.7)

# ---- group: Testing sandbox
nt_series = Relay()  # disabled
t_series = Relay()  # disabled
nterms = Slider(30, range=0..100)  # disabled
count = Relay()  # disabled
start = Slider(4, range=0..5)  # disabled
factor = Slider(1.029, range=0..2)  # disabled
sides = Slider(4, range=0..100)  # disabled
phase = Slider(0.509, range=0..3)  # disabled
fibonacci_series = Number([2, 3, 5, 8, 13, 21, 34, 55, 89, 144, 233, 377, 610, 987, 1597, 2584, 4181])  # disabled
nterms_2 = Slider(1, range=1..20)  # disabled
ghpython_script = GhPythonScript(nterms=nterms)  # -> out, fib_list; inputs nterms: Int32; disabled
# ---------- ghpython_script: Python ----------
__author__ = "owly"
__version__ = "2022.09.26"

import rhinoscriptsyntax as rs

fib_list = []
def fib(l):
    if l<=1:
        return l  
    else:
        return fib(l-1)+fib(l-2)

for n in range(nterms):
    fib_list.append(fib(n))
# ---------- end ghpython_script ----------
expression = Expression(start=start, factor=factor, t=t_series, Expression="start*factor^t")  # disabled
expression_2 = Expression(count=count, sides=sides, Expression="count/sides")  # disabled
panel = Panel(fibonacci_series)  # disabled
panel_2 = Panel(ghpython_script.fib_list)  # disabled
panel_3 = Panel(expression_2)  # disabled
ghpython_script_2 = GhPythonScript(term=panel, nterms=nterms_2)  # -> out, a; disabled
# ---------- ghpython_script_2: Python ----------
__author__ = "owly"
__version__ = "2022.09.26"

import rhinoscriptsyntax as rs
term = int(term)
a = []
#for term in series:
for n in range(term+1):
    a.append(n/term)
# ---------- end ghpython_script_2 ----------
expression_3 = Expression(Expression="Format(\"{0}, {1}\", x, y)")  # disabled
panel_4 = Panel("{2}")  # disabled
ghpython_script_3 = GhPythonScript(t=nt_series, radius=expression, cycle=expression_2, phase=phase)  # -> out, x, y; disabled
# ---------- ghpython_script_3: Python ----------
__author__ = "owly"
__version__ = "2022.09.24"

import rhinoscriptsyntax as rs
from math import *


x = radius*cos(2*pi*t*cycle+phase)
y = radius*sin(2*pi*t*cycle+phase)
# ---------- end ghpython_script_3 ----------
panel_5 = Panel(ghpython_script_2.a)  # disabled
split_tree = SplitTree(Data=simplify(ghpython_script_2.a), Masks=flatten(panel_4))  # -> Positive, Negative; disabled
ghpython_script_4 = GhPythonScript(t=ghpython_script_2.a)  # -> out, a; disabled
# ---------- ghpython_script_4: Python ----------
import math

_x = math.cos(2 


a = t
# ---------- end ghpython_script_4 ----------
construct_point = ConstructPoint(XCoordinate=ghpython_script_3.x, YCoordinate=ghpython_script_3.y, ZCoordinate=0)  # disabled
number = Number(1)  # disabled
panel_6 = Panel(ghpython_script_4.a)  # disabled
tree_branch = TreeBranch(Tree=panel_5, Path=number, MaintainPaths=True)  # disabled
polyline = PolyLine(Vertices=construct_point, Closed=False)  # disabled
ghpython_script_5 = GhPythonScript(x=panel_5)  # -> out, a; disabled
# ---------- ghpython_script_5: Python ----------
__author__ = "owly"
__version__ = "2022.09.26"

import rhinoscriptsyntax as rs
print(x)
# ---------- end ghpython_script_5 ----------
panel_7 = Panel(ghpython_script_5.out)  # disabled
custom_preview = CustomPreview(
    Geometry=polyline,
    Material={diffuse=RGB(221, 160, 221), emission=RGB(66, 48, 66), shine=0.5, specular=RGB(255, 255, 255), transparency=0})  # disabled

# ---- group: Starting series
# CLICK + HOLD ALT to copy and paste the item
# CTRL + ALT + CLICK to find component in topbar
count_2 = Slider(101, range=0..500)
series = Series(Start=0, Step=1, Count=count_2)
series_2 = Series(Start=0, Step=expr("1/(x-1)", count_2), Count=count_2)

# ---- group: Circle outline / Circle
start_2 = Slider(4, range=0..5)
factor_2 = Slider(1.11, range=0..2)
phase_2 = Slider(3, range=0..3)
sides_2 = Slider(2, range=0..40)
expression_4 = Expression(start=start_2, factor=factor_2, t=series, Expression="start*factor^t")
expression_5 = Expression(count=count_2, sides=sides_2, Expression="count/sides")
panel_8 = Panel(expression_5)
ghpython_script_6 = GhPythonScript(t=series_2, radius=expression_4, cycle=expression_5, phase=phase_2)  # -> out, x, y; same code as ghpython_script_3

# ---- group: Points
divider = Slider(2, range=0..50)
construct_point_2 = ConstructPoint(XCoordinate=ghpython_script_6.x, YCoordinate=ghpython_script_6.y, ZCoordinate=0)
division = Division(BigRadius=expression_4, Divider=divider)
construct_point_3 = ConstructPoint(XCoordinate=ghpython_script_6.x, YCoordinate=ghpython_script_6.y, ZCoordinate=division)

# ---- group: Small circles
circle = Circle(Plane=construct_point_3, Radius=division)
circle_2 = Circle(Plane=construct_point_2, Radius=division)

# ---- group: Vertex lines
density = Slider(41, range=0..50)
shift = Slider(20, range=1..20)
divide_curve = DivideCurve(Curve=circle, Count=density, Kinks=False)  # -> Points, Tangents, Parameters
divide_curve_2 = DivideCurve(Curve=circle_2, Count=density, Kinks=False)  # -> Points, Tangents, Parameters
shift_list = ShiftList(List=divide_curve.Points, Shift=shift, Wrap=True)
line = Line(StartPoint=divide_curve_2.Points, EndPoint=shift_list)
series_3 = Series(Start=0, Step=expr("1/(x-1)", density), Count=density)

# ---- group: Display
colour_hsl = ColourHSL(Alpha=1, Hue=series_2, Saturation=1, Luminance=0.5)
colour_hsl_2 = ColourHSL(Alpha=1, Hue=series_3, Saturation=1, Luminance=0.5)
custom_preview_2 = CustomPreview(Geometry=[circle, circle_2], Material=colour_hsl)
custom_preview_3 = CustomPreview(Geometry=line, Material=colour_hsl_2)
